# Grasshopper definition basic_ur_setup_rested.gh (Grasshopper 1.0.8)

curve = Curve(<curve referenced from the Rhino model>)
xy_plane = XYPlane(Origin=Point(0, 0, 0))

# ---- group: EVE - UR10e
table_mesh = Mesh(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)
mesh = Mesh([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])
ur10e = Python3Script(scale="1000")  # -> dh, joint_lim; inputs scale: Double
# ---------- ur10e: Python ----------
from math import pi

# UR10e parameters: [d, a, alpha, theta_offset] (meters / radians) 
dh = [
    [0.1807,  0.0,     0.5 * pi, 0.0],
    [0.0,     0.6127,  0.0,      0.5 * pi],
    [0.0,     0.57155, 0.0,      0.0],
    [0.17415, 0.0,     0.5 * pi, 0.5 * pi],
    [0.11985, 0.0,    -0.5 * pi, 0.0],
    [0.11655, 0.0,     0.0,      0.0],
]
joint_lim = [(-2 * pi , 2 * pi)] * 6
scale = scale if scale else 1.0


for x in dh:
    x[0]*=scale
    x[1]*=scale
# ---------- end ur10e ----------

# ----
divide_curve = DivideCurve(Curve=curve, Count=Slider(300, range=0..300), Kinks=False)  # -> Points, Tangents, Parameters
xz_plane = XZPlane(Origin=divide_curve.Points)
surface = Surface(xz_plane)

# ---- group: DEBUG PLANE
surface_2 = Surface(surface)
evaluate_surface = EvaluateSurface(Surface=reparameterize(surface_2), Point="{0.5,0.5,0}")  # -> Point, Normal, UDirection, VDirection, Frame
xy_plane_2 = XYPlane(Origin=Point(0, 0, 0))
pln2pose = PlaneToEuler(scale="1000", source=xy_plane_2, target=evaluate_surface.Frame)  # -> out, pose, translation, rotation; inputs source: Plane, target: Plane
# ---------- pln2pose: Python ----------
import math
import Rhino.Geometry as rg


trns_orig = rg.Transform.PlaneToPlane(source,rg.Plane.WorldXY)
target.Transform(trns_orig)
trns = rg.Transform.PlaneToPlane(target,rg.Plane.WorldXY)

qt = rg.Quaternion.Rotation(rg.Plane.WorldXY,target)


angle = 2 * math.acos(qt.A);
s = math.sqrt(1-qt.A*qt.A); # assuming quaternion normalised then w is less than 1, so term always positive.
if (s < 0.001) : # test to avoid divide by zero, s is always positive due to sqrt
    # if s close to zero then direction of axis not important
    x = qt.B; # if it is important that axis is normalised then replace with x=1; y=z=0;
    y = qt.C;
    z = qt.D;
else:
    x = qt.B / s; # normalise axis
    y = qt.C / s;
    z = qt.D / s;

axis_angle = rg.Vector3d(x,y,z) * angle

translation = rg.Vector3d(
    target.Origin.X / scale,
    target.Origin.Y / scale,
    target.Origin.Z / scale
)
rotation = axis_angle

pose = [
    target.Origin.X / scale,
    target.Origin.Y / scale,
    target.Origin.Z / scale,
    axis_angle.X,
    axis_angle.Y,
    axis_angle.Z
]
# ---------- end pln2pose ----------
panel = Panel(pln2pose.translation)
panel_2 = Panel(pln2pose.rotation)
plane = Plane(evaluate_surface.Frame)

# ----
ghpython_script = PythonScript(param=Slider(0.652, range=0..1), plns=plane, long_path="False")  # -> out, pln_X, param, pln_index, debug; inputs plns: list of Plane
# ---------- ghpython_script: Python ----------
import Rhino.Geometry as rg
import math

ANGLE_DIST_COEF = 10

def clamp_number(_number):
    if _number < -1.0:
        _number = -1.0
    elif _number > 1.0:
        _number = 1.0
    return _number

def quat2transf(q):
    m = rg.Transform()

    xx = q.B * q.B
    xy = q.B * q.C
    xz = q.B * q.D
    xw = q.B * q.A

    yy = q.C * q.C
    yz = q.C * q.D
    yw = q.C * q.A

    zz = q.D * q.D
    zw = q.D * q.A

    m[0, 0] = 1 - 2 * (yy + zz)
    m[0, 1] = 2 * (xy - zw)
    m[0, 2] = 2 * (xz + yw)

    m[1, 0] = 2 * (xy + zw)
    m[1, 1] = 1 - 2 * (xx + zz)
    m[1, 2] = 2 * (yz - xw)

    m[2, 0] = 2 * (xz - yw)
    m[2, 1] = 2 * (yz + xw)
    m[2, 2] = 1 - 2 * (xx + yy)

    m[3, 3] = 0
    m[0, 3] = m[1, 3] = m[2, 3] = m[3, 0] = m[3, 1] = m[3, 2] = 0

    return m

def islerp(qb,t,is_long):
    cos_half_theta = qb.A
    flip = 1

    if (not is_long ^ (cos_half_theta > 0.0)):
        cos_half_theta = -cos_half_theta
        flip = -1
    
    if (abs(cos_half_theta) >= 1.0):
        return rg.Quaternion.Identity
    
    half_theta = math.acos(cos_half_theta)
    sin_half_theta = math.sqrt(1.0 - cos_half_theta**2)
    if (abs(sin_half_theta) < 0.001):
        qt = qb * 0.5 * flip
        qt.A += 0.5
        return qt
    
    ratioA = math.sin((1.0 - t) * half_theta) / sin_half_theta
    ratioB = math.sin(t * half_theta) / sin_half_theta
    qt = qb * ratioB * flip
    qt.A += ratioA
    return qt
    
def norm_ang_deg(_ang):
    if _ang < -180: _ang += 2 * 180
    elif _ang > 180: _ang -= 2 * 180
    return _ang

def get_pln_act(_pln,_axis_pln,_axis_value):
    tf1 = rg.Transform.PlaneToPlane(rg.Plane.WorldXY,_axis_pln)
    tf2 = rg.Transform.Rotation(math.radians(_axis_value),_axis_pln.ZAxis,_axis_pln.Origin)
    _new_pln = rg.Plane(_pln)
    _new_pln.Transform(tf1)
    _new_pln.Transform(tf2)
    return _new_pln

def get_pln_rel(_pln,_axis_pln,_axis_value):
    tf1 = rg.Transform.Rotation(-math.radians(_axis_value),_axis_pln.ZAxis,_axis_pln.Origin)
    tf2 = rg.Transform.PlaneToPlane(_axis_pln,rg.Plane.WorldXY)
    _new_pln = rg.Plane(_pln)
    _new_pln.Transform(tf1)
    _new_pln.Transform(tf2)
    return _new_pln

dist_all = 0
plns_tup = []
debug=[]

for i,p in enumerate(plns[:-1]):
    i +=1
    #get quat between pln and next pln
    this_pln = p
    next_pln = plns[i]
    #debug.append(this_pln)
    #debug.append(next_pln)
    q = rg.Quaternion.Rotation(this_pln,next_pln)
    angle = 2 * math.acos(clamp_number(q.A)) 
    angle -= (angle//math.pi)*2*math.pi
    distance = (next_pln.Origin-this_pln.Origin).Length
    angle_distance = (next_pln.ZAxis.VectorAngle(next_pln.ZAxis,this_pln.ZAxis)/math.pi)*180*ANGLE_DIST_COEF
    if distance < angle_distance*10:
        distance = angle_distance
    dist_all += distance
    plns_tup.append((i-1,dist_all,distance,this_pln))
closest_pln = filter(lambda x: x[1] > param*dist_all,plns_tup)
if closest_pln:
    closest_pln = min(closest_pln)
else:
    closest_pln = (i-1,dist_all,1,plns[-1])
pln_A = closest_pln[-1]
pln_index = closest_pln[0]
pln_B = plns[closest_pln[0]+1]
param = (param*dist_all-closest_pln[1]+closest_pln[2])/closest_pln[2]
print param

debug.append(pln_A)
debug.append(pln_B)
long_path = long_path==True
qt = islerp(
    rg.Quaternion.Rotation(pln_A,pln_B),
    param,
    long_path)
transf = quat2transf(qt)
pln_X = rg.Plane(pln_A)
pln_X.Transform(transf)
pln_X.Origin = pln_A.Origin + (pln_B.Origin-pln_A.Origin)*param
debug.append(pln_X)
# ---------- end ghpython_script ----------

# ---- group: IK
joint_lim = Data(ur10e.joint_lim)
target = Plane(ghpython_script.pln_X)
dh = Data(ur10e.dh)
python_3_script = Python3Script(dh=dh, joint_lim=joint_lim, target=target)  # -> out, best, sols, valid; inputs dh: list, joint_lim: list, target: Plane
# ---------- python_3_script: Python ----------
import math
import Rhino.Geometry as rg
from Grasshopper import DataTree
from Grasshopper.Kernel.Data import GH_Path

PI = math.pi
# helpers
def normalize_angle(t):
    while t < -PI:
        t += 2.0 * PI
    while t > PI:
        t -= 2.0 * PI
    return t


def safe_acos(x):
    return math.acos(max(-1.0, min(1.0, x)))


def dh_transform(d, a, alpha, theta):
    ct, st = math.cos(theta), math.sin(theta)
    ca, sa = math.cos(alpha), math.sin(alpha)
    t = rg.Transform.Identity
    t[0, 0] = ct;  t[0, 1] = -st * ca; t[0, 2] = st * sa;  t[0, 3] = a * ct
    t[1, 0] = st;  t[1, 1] = ct * ca;  t[1, 2] = -ct * sa; t[1, 3] = a * st
    t[2, 0] = 0.0; t[2, 1] = sa;       t[2, 2] = ca;       t[2, 3] = d
    t[3, 0] = 0.0; t[3, 1] = 0.0;      t[3, 2] = 0.0;      t[3, 3] = 1.0
    return t


def inverse(t):
    ok, inv = t.TryGetInverse()
    if not ok:
        raise ValueError("Transform is not invertible")
    return inv


def plane_to_transform(plane, unit_scale):
    """Target plane (Rhino units) -> 4x4 transform in meters, relative to the world origin."""
    p = rg.Plane(plane)
    p.Origin = plane.Origin * unit_scale
    return rg.Transform.PlaneToPlane(rg.Plane.WorldXY, p)


# IK
def ur_ik(dh, T):
    """
    Returns a list of 8 solutions; each is a list of 6 angles (radians) or None.
    Index bit flags: (SHOULDER << 2) | (WRIST_FLIP << 1) | (ELBOW << 0)
    """
    d = [r[0] for r in dh]
    a = [r[1] for r in dh]
    alpha = [r[2] for r in dh]
    off = [r[3] for r in dh]

    # wrist center
    p05x = T[0, 3] - d[5] * T[0, 2]
    p05y = T[1, 3] - d[5] * T[1, 2]
    r = math.hypot(p05x, p05y)

    solutions = [None] * 8
    if r < abs(d[3]):
        return solutions

    for i in range(8):
        s = 1 if i < 4 else -1
        t0 = math.atan2(p05y, p05x) + s * safe_acos(d[3] / r) + 0.5 * PI
        c, sn = math.cos(t0), math.sin(t0)

        arg = (T[0, 3] * sn - T[1, 3] * c - d[3]) / d[5]
        if abs(arg) > 1.0:
            continue
        t4 = (1 if (i % 4) < 2 else -1) * safe_acos(arg)
        if abs(math.sin(t4)) < 1e-6:      # wrist singularity
            continue

        t5 = math.atan2((-T[0, 1] * sn + T[1, 1] * c) / math.sin(t4),
                        ( T[0, 0] * sn - T[1, 0] * c) / math.sin(t4))

        # T14 = inv(T01) * T * inv(T56) * inv(T45)
        T14 = (inverse(dh_transform(d[0], a[0], alpha[0], t0))
               * T
               * inverse(dh_transform(d[5], a[5], alpha[5], t5))
               * inverse(dh_transform(d[4], a[4], alpha[4], t4)))

        px, py = T14[0, 3], T14[1, 3]
        c2 = (px * px + py * py - a[1] ** 2 - a[2] ** 2) / (2.0 * a[1] * a[2])
        if abs(c2) > 1.0 + 1e-9:
            continue
        t2 = (1 if (i % 2) == 0 else -1) * safe_acos(c2)
        t1 = math.atan2(py, px) - math.atan2(a[2] * math.sin(t2), a[1] + a[2] * math.cos(t2))
        t3 = math.atan2(T14[1, 0], T14[0, 0]) - t1 - t2

        raw = (t0, t1, t2, t3, t4, t5)
        solutions[i] = [normalize_angle(v - o) for v, o in zip(raw, off)]

    return solutions


def within_limits(theta, lim):
    if theta is None:
        return False
    for k in range(len(theta)):
        if not (lim[k][0] <= theta[k] <= lim[k][1]):
            return False
    return True


def select_closest(solutions, previous, lim):
    best, best_sum = None, 1e9
    for th in solutions:
        if not within_limits(th, lim):
            continue
        if previous is None:
            return th
        ssum = sum(abs(normalize_angle(th[j] - previous[j])) for j in range(6))
        if ssum < best_sum:
            best, best_sum = th, ssum
    return best


def select_configuration(solutions, overhead, wrist_flip, elbow_down, lim):
    idx = (int(overhead) << 2) | (int(wrist_flip) << 1) | int(elbow_down)
    th = solutions[idx]
    return th if within_limits(th, lim) else None


# GH
best = None
valid = []
sols = DataTree[float]()

if target is not None:
    T = plane_to_transform(target, 1.0)
    all_sol = ur_ik(dh, T)

    for i, th in enumerate(all_sol):
        path = GH_Path(i)
        if th is not None:
            sols.AddRange(th, path)
        valid.append(within_limits(th, joint_lim))

    prev_vals = list(prev) if prev and len(prev) == 6 else None
    best = select_closest(all_sol, prev_vals, joint_lim)

    # or force a fixed configuration instead:
    # best = select_configuration(all_sol, overhead=False, wrist_flip=False, elbow_down=False, lim=joint_lim)
# ---------- end python_3_script ----------
tree_branch = TreeBranch(Tree=python_3_script.sols, Path="{2}", MaintainPaths=True)
degrees = Degrees(Radians=tree_branch)
joint_values = Panel(degrees)
ik_joint = Number(tree_branch)

# ---- group: VISUALIZATION
table_mesh_2 = Mesh(table_mesh)
base = Plane(xy_plane)
mesh_2 = Mesh(mesh)
dh_2 = Data(ur10e.dh)
python_3_script_2 = Python3Script(dh=dh_2, q=ik_joint)  # -> out, plns; inputs dh: list, q: list
# ---------- python_3_script_2: Python ----------
import math
import Rhino.Geometry as rg

def dh_transform(d, a, alpha, theta):
    ct, st = math.cos(theta), math.sin(theta)
    ca, sa = math.cos(alpha), math.sin(alpha)
    t = rg.Transform.Identity
    t[0, 0] = ct;  t[0, 1] = -st * ca; t[0, 2] = st * sa;  t[0, 3] = a * ct
    t[1, 0] = st;  t[1, 1] = ct * ca;  t[1, 2] = -ct * sa; t[1, 3] = a * st
    t[2, 0] = 0.0; t[2, 1] = sa;       t[2, 2] = ca;       t[2, 3] = d
    return t

def to_plane(t, scale = 1.0):
    origin = rg.Point3d(t[0, 3], t[1, 3], t[2, 3]) * scale
    x_axis = rg.Vector3d(t[0, 0], t[1, 0], t[2, 0])
    y_axis = rg.Vector3d(t[0, 1], t[1, 1], t[2, 1])
    return rg.Plane(origin, x_axis, y_axis)

plns = []


n = len(dh)
angles = list(q) if q else [0.0] * n

T = rg.Transform.Identity
plns.append(to_plane(T))                      # base frame

for i in range(n):
    d, a, alpha, off = dh[i]
    T = T * dh_transform(d, a, alpha, angles[i] + off)
    plns.append(to_plane(T))
# ---------- end python_3_script_2 ----------
python_3_script_3 = Python3Script(dh=dh_2)  # -> out, plns; inputs dh: list, q: list; same code as python_3_script_2
orient = Orient(Geometry=mesh_2, Source=python_3_script_3.plns, Target=python_3_script_2.plns)  # -> Geometry, Transform
orient_2 = Orient(Geometry=orient.Geometry, Source=PlaneXY(0, 0, 0), Target=base)  # -> Geometry, Transform
orient_3 = Orient(Geometry=table_mesh_2, Source=PlaneXY(0, 0, 0), Target=base)  # -> Geometry, Transform
list_item = ListItem(List=reverse(python_3_script_2.plns), Index=0, Wrap=True)
robot_mesh = Mesh(orient_2.Geometry)
table_mesh_3 = Mesh(orient_3.Geometry)
custom_preview = CustomPreview(Geometry=table_mesh_3, Material=ColourSwatch(SwatchColor=RGB(64, 64, 64)))
custom_preview_2 = CustomPreview(Geometry=robot_mesh, Material=ColourSwatch(SwatchColor=RGB(194, 194, 194)))
plane_2 = Plane(list_item)

# ---- group: INPUT PLANES
plane_3 = Plane(plane)

# ----
xy_plane_3 = XYPlane(Origin=Point(0, 0, 0))

# ---- group: TOOL DEFINITION
tcp_plane = Plane(xy_plane_3)
scale = Number("1000")
source = Plane(xy_plane_3)
pln2pose_2 = PlaneToEuler(scale=scale, source=source, target=tcp_plane)  # -> out, pose, translation, rotation; inputs source: Plane, target: Plane; same code as pln2pose
inertia = Panel("""0.000014
0.000014
0.000014
0
0
0""")
payload = Panel("0.06")
cog = Panel("""0
0
0""")

# ----
home_pos = Panel("""90
-90
90
-80
-90
180""")
gravity = Panel("""0
0
9.82""")

# ---- group: CODE GENERATION
header = Panel("""global runTimer = 0
global isRunning = False
thread collectUseTime():
 while(True):
  if(isRunning):
   runTimer = runTimer + get_steptime() 
  end
  sync()
 end
end
collectUseTimeThrd = run collectUseTime()""")
base_pln = Plane(xy_plane_3)
tail = Panel("""kill collectUseTimeThrd 
popup_msg = str_cat("Program end reached: ", runTimer)
popup(popup_msg, title="Program end", warning=True, error=False,
blocking=True)""")
scale_2 = Number("1000")
path_plns = Plane(plane_3)
blend = Panel("0.03")
acc = Panel("0.3")
vel = Panel("0.15")
pln2pose_3 = PlaneToEuler(scale=scale_2, source=base_pln, target=path_plns)  # -> out, pose, translation, rotation; inputs source: Plane, target: Plane; same code as pln2pose
list_length = ListLength(List=pln2pose_3.translation)
duplicate_data = DuplicateData(Data=acc, Number=list_length, Order=True)
duplicate_data_2 = DuplicateData(Data=vel, Number=list_length, Order=True)
duplicate_data_3 = DuplicateData(Data=blend, Number=list_length, Order=True)
body = GhPythonScript(
    header=header,
    TCP_translation=pln2pose_2.translation,
    TCP_rotation=pln2pose_2.rotation,
    tool_payload=payload,
    tool_cog=cog,
    tool_inertia=inertia,
    gravity=gravity)  # -> out, header; inputs header: list, TCP_translation: Vector3d, TCP_rotation: Vector3d, tool_cog: list, tool_inertia: list, gravity: list
# ---------- body: Python ----------
__author__ = "ondre"
__version__ = "2023.06.22"
import math

header.extend([
"# STANDARD SETTINGS",
"# use payload data (mass, cog, inertia)",
"set_target_payload({0}, [{1[0]}, {1[1]}, {1[2]}], [{2[0]}, {2[1]}, {2[2]}, {2[3]}, {2[4]}, {2[5]}])".format(
    tool_payload,
    tool_cog,
    tool_inertia
),
"# use soft transition mode (0 == hard, 1 == soft)",
"set_safety_mode_transition_hardness(1)",
"# set TCP transformation",
"set_tcp(p[{0[0]}, {0[1]}, {0[2]}, {1[0]}, {1[1]}, {1[2]}])".format(
    TCP_translation,
    TCP_rotation
), 
"# set gravity (in case of different robot mounting or Mars installation)",
"set_gravity([{0[0]}, {0[1]}, {0[2]}])".format(
    gravity
),
"# IO SETTINGS",
"# set tool serial communication using availible analog inputs",
"set_tool_communication(False, 115200, 0, 1, 1.5, 3.5)",
"# 0 == digital, 1 == power",
"set_tool_output_mode(0)",
"# 1 == Sinking/NPN, 2 == Sourcing / PNP, 3 == Push-Pull",
"set_tool_digital_output_mode(0, 1)",
"set_tool_digital_output_mode(1, 1)",
"set_tool_voltage(0)",
"# analog domains (0 == 4-20mA, 1 == 0-10V)",
"set_standard_analog_input_domain(0, 1)",
"set_standard_analog_input_domain(1, 1)",
"set_tool_analog_input_domain(0, 1)",
"set_tool_analog_input_domain(1, 1)",
"set_analog_outputdomain(0, 0)",
"set_analog_outputdomain(1, 0)",
"# set everything to default",
"set_input_actions_to_default()" 
])
# ---------- end body ----------
body_2 = GhPythonScript(
    translation=pln2pose_3.translation,
    rotation=pln2pose_3.rotation,
    acc=duplicate_data,
    vel=duplicate_data_2,
    blend=duplicate_data_3,
    homepos=home_pos)  # -> out, body; inputs translation: list of Vector3d, rotation: list of Vector3d, acc: list, vel: list, blend: list, homepos: list
# ---------- body_2: Python ----------
__author__ = "ondre"
__version__ = "2023.06.22"
import math

body = []
body.append("movej([{0[0]}, {0[1]}, {0[2]}, {0[3]}, {0[4]}, {0[5]}], a={1}, v={2}, r={3})".format(
    [math.radians(x) for x in homepos],
    math.pi*0.5,
    math.pi*0.1,
    0
))
for i, tr in enumerate(translation):
    is_last = i+1 == len(translation)
    if i==0:
        body.append("movej(p[{0[0]}, {0[1]}, {0[2]}, {1[0]}, {1[1]}, {1[2]}], a={2}, v={3}, r={4})".format(
        tr,
        rotation[i],
        math.pi*0.5,
        math.pi*0.1,
        0
        ))
        body.append("stopj({0})".format(math.pi))
        body.append('popup("Confirm program start", title="Program start", warning=True, error=False, blocking=True)')
        body.append("isRunning = True")
    body.append("movel(p[{0[0]}, {0[1]}, {0[2]}, {1[0]}, {1[1]}, {1[2]}], a={2}, v={3}, r={4})".format(
    tr,
    rotation[i],
    acc[i],
    vel[i],
    0 if is_last else blend[i]
    ))
body.append("isRunning = False")
# ---------- end body_2 ----------
body_3 = Panel(body_2.body)
ghpython_script_2 = GhPythonScript(header=body.header, body=body_2.body, tail=tail)  # -> code; inputs header: list, body: list, tail: list
# ---------- ghpython_script_2: Python ----------
__author__ = "ondre"
__version__ = "2023.06.23"

code = []
code.append("# ---HEADER---")
code.extend(header)
code.append("")
code.append("# ---BODY---")
code.extend(body)
code.append("# ---TAIL---")
code.extend(tail)
# ---------- end ghpython_script_2 ----------
code = Panel(ghpython_script_2)

# ---- group: FRAMES
deconstruct_plane = DeconstructPlane(Plane=graft(path_plns))  # -> Origin, XAxis, YAxis, ZAxis
panel_3 = Panel("""Red
Green
Blue""")
vector = Vector([deconstruct_plane.XAxis, deconstruct_plane.YAxis, deconstruct_plane.ZAxis])
amplitude = Amplitude(Vector=vector, Amplitude="50")
vector_display_ex = VectorDisplayEx(Point=deconstruct_plane.Origin, Vector=amplitude, Colour=panel_3, Width=2)

# ---- group: BLEND
circle = Circle(Plane=PlaneXY(0, 0, 0), Radius=expr("x*1000", blend))
custom_preview_3 = CustomPreview(Geometry=circle, Material=ColourSwatch(SwatchColor=RGB(255, 69, 236)))

# ---- group: AUTOMATIC SEND
tail_2 = Text(tail)
body_4 = Text(body_2.body)
header_2 = Text(body.header)
ghpython_script_3 = GhPythonScript(header=header_2, body=body_4, tail=tail_2)  # -> code; inputs header: list, body: list, tail: list
# ---------- ghpython_script_3: Python ----------
__author__ = "ondre"
__version__ = "2023.06.23"

code = []
code.append("def auto_send():")
code.append("# ---HEADER---")
code.extend(["  "+x for x in header])
code.append("")
code.append("# ---BODY---")
code.extend(["  "+x for x in body])
code.append("# ---TAIL---")
code.extend(["  "+x for x in tail])
code.append("end")
# ---------- end ghpython_script_3 ----------
panel_4 = Panel(ghpython_script_3)
send = Button()
ghpython_script_4 = GhPythonScript(send=send, prg=panel_4)  # -> out; inputs send: Boolean, prg: list
# ---------- ghpython_script_4: Python ----------
__author__ = "ondre"
__version__ = "2023.06.22"

import socket

HOST = host
PORT = 30002
prg_string = ""
if send:
    for line in prg:
        prg_string += line
        prg_string += "\n"
    sock = socket.socket(socket.AF_INET, socket.SOCK_STREAM)
    try:
        sock.settimeout(5)
        sock.connect((HOST, PORT))
        data = sock.recv(79)
        sock.sendall(prg_string)
        print(data)
        print('Done')
    except Exception as e:
        print e
    finally:
        sock.shutdown(socket.SHUT_RDWR)
        sock.close()
# ---------- end ghpython_script_4 ----------
panel_5 = Panel(ghpython_script_4)
